# Grasshopper definition 01 Parametric FEM Toolbox - Get Data.gh (Grasshopper 1.0.8)
# plug-ins: Parametric_FEM_Toolbox

# ----
# Plugin Description: This Plug-In enables an interoperability between RFEM and Grasshopper through the RFCOM API.
# 
# It allows the user to import data from RFEM into Grasshopper and also to define new model data through the Grasshopper interface.
# Contact: Diego Apellániz M.Sc.
# Ph.D. Candidate | Research Associate (UdK Berlin)
# Structural Engineer and Computational Design Specialist (Bollinger + Grohmann)
# 
# Lehrstulfür Konstruktives Entwerfen und Tragwerksplanung (KET)
# Studiengang Architektur
# Universität der Künste Berlin
# Hardenbergstr.33
# D 10623 Berlin
# 
# Telefon+49 (0)30 3185 2994
# Telefax +49 (0)30 3185 2992
# 
# E-Mail: d.apellaniz@udk-berlin.de
# Connect on Linkedin: linkedin.com/in/diegoapellaniz
# Related RFEM File(s): 01 RFCOM - Get Data.rf5
# Description: The process of importing data from RFEM into Grasshopper revolves around the "Get Data" Component. The following concepts are explored:
# 
# - Functioning of "Get Data" Component
# - Object Oriented structure of the RFEM Plugin
# - Filters
# - Supported geometry types - pretty much everything
# - Supported List formats
# - Serialization of RF-Objects
# - Working with several open RFEM models
# - Panels as a way of displaying object properties
# - Casting of RF-Objects into Grasshopper Geometry Types
# - Definition of nodal supports with custom orientation
grasshopper_version = Panel("1.0.0007")
plugin = Panel("Parametric FEM Toolbox")

# ----
# Index lists with
# "Rfem-format"
# are supported!
panel = Panel("Bauteil 1")
# It is possible to specify the name of the
# model - or a part of it - to get the data from.
# However, all open models have to
# belong to the same RFEM application
# (window). If no name is provided, the
# connection will be set with the RFEM
# model which was opened first.
panel_2 = Panel("15-16")
# Try connecting the filters to the "Get Data"
# Component - and run it again. This way
# you can filter the data of the RFEM-Model
# to import into Grasshopper and the "Get
# Data" Component will also be faster!
filter_data = FilterData(Comment=panel, mode="Members")
filter_data_2 = FilterData(Comment=panel, mode="Surfaces")
filter_data_3 = FilterData(NodesNo=panel_2, mode="Nodal Supports")
# AFTER OPENING THE RFEM MODEL,
# click on the button to import the
# data of  your RFEM Model into
# Grasshopper in the form of the so called
# RF-Objects.
# 
# These objects have been built over the
# classes of the RFCOM API, however they
# have additional properties and methods,
# which makes it possible to operate with
# them without calling the RFEM Modell
# again.
# 
# Unlike native RFCOM classes, they also
# support serialization, which means that
# they can be stored and internalised in
# grasshopper containers.
# 
# Just the Components "Get Data"
# and "Set Data" need to call the model
# when they are run and thus lock a RFCOM
# License.
panel_3 = Panel("Get Data")
toggle = BooleanToggle(True)
# Try internalizing RF-Objects in
# containers. Persistent data remains
# when the grasshopper file is closed!
button = Button()
get_data = GetData(
    RunComponent=button,
    Nodes=toggle,
    Lines=toggle,
    Members=toggle,
    Surfaces=toggle,
    Openings=toggle,
    NodalSupports=toggle,
    LoadCases=toggle,
    LoadCombos=toggle,
    RCombos=toggle,
    ModelName=panel_3)  # -> RFNodes, RFLines, RFMembers, RFSurfaces, RFOpenings, RFNodalSupports, RFLineSupports, RFSurfaceSupports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
rf_object = RFObject(["{\"Comment\":\"\",\"CS\":1,\"Delta1\":0.0,\"Delta2\":0.0,\"ID\":\"\",\"IsGenerated\":false,\"IsValid\":true,\"No\":1,\"RefObjectNo\":0,\"Tag\":\"\",\"Type\":1,\"X\":0.0,\"Y\":0.0,\"Z\":0.0,\"Location\":{\"X\":0.0,\"Y\":0.0,\"Z\":0.0},\"ToModify\":false,\"ToDelete\":false}", "{\"Comment\":\"\",\"CS\":1,\"Delta1\":0.0,\"Delta2\":0.0,\"ID\":\"\",\"IsGenerated\":false,\"IsValid\":true,\"No\":2,\"RefObjectNo\":0,\"Tag\":\"\",\"Type\":1,\"X\":0.0,\"Y\":5.0,\"Z\":0.0,\"Location\":{\"X\":0.0,\"Y\":5.0,\"Z\":0.0},\"ToModify\":false,\"ToDelete\":false}", "{\"Comment\":\"Bauteil 1\",\"CS\":1,\"Delta1\":0.0,\"Delta2\":0.0,\"ID\":\"\",\"IsGenerated\":false,\"IsValid\":true,\"No\":3,\"RefObjectNo\":0,\"Tag\":\"\",\"Type\":1,\"X\":6.0,\"Y\":5.0,\"Z\":0.0,\"Location\":{\"X\":6.0,\"Y\":5.0,\"Z\":0.0},\"ToModify\":false,\"ToDelete\":false}", "{\"Comment\":\"Bauteil 1\",\"CS\":1,\"Delta1\":0.0,\"Delta2\":0.0,\"ID\":\"\",\"IsGenerated\":false,\"IsValid\":true,\"No\":4,\"RefObjectNo\":0,\"Tag\":\"\",\"Type\":1,\"X\":6.0,\"Y\":0.0,\"Z\":0.0,\"Location\":{\"X\":6.0,\"Y\":0.0,\"Z\":0.0},\"ToModify\":false,\"ToDelete\":false}", "{\"Comment\":\"\",\"CS\":1,\"Delta1\":0.0,\"Delta2\":0.0,\"ID\":\"\",\"IsGenerated\":false,\"IsValid\":true,\"No\":5,\"RefObjectNo\":0,\"Tag\":\"\",\"Type\":1,\"X\":0.0,\"Y\":0.0,\"Z\":-3.0,\"Location\":{\"X\":0.0,\"Y\":0.0,\"Z\":-3.0},\"ToModify\":false,\"ToDelete\":false}", "{\"Comment\":\"Bauteil 1\",\"CS\":1,\"Delta1\":0.0,\"Delta2\":0.0,\"ID\":\"\",\"IsGenerated\":false,\"IsValid\":true,\"No\":6,\"RefObjectNo\":0,\"Tag\":\"\",\"Type\":1,\"X\":6.0,\"Y\":8.0,\"Z\":0.0,\"Location\":{\"X\":6.0,\"Y\":8.0,\"Z\":0.0},\"ToModify\":false,\"ToDelete\":false}"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])
rf_object_2 = RFObject(get_data.RFNodes)
panel_4 = Panel(rf_object_2)
rfmember = RFMember(RFMember=get_data.RFMembers, mode="Disassemble")  # -> Line, MemberNumber, Comment, LineNumber, MemberType, RotationAngle_, RotationType, StartCrossSection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
rfnodalsupport = RFNodalSupport(RFNodalSupport=get_data.RFNodalSupports, mode="Disassemble")  # -> Location, SupportNumber, DisplacementDirX, DisplacementDirY, DisplacementDirZ, RotationDirX, RotationDirY, RotationDirZ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
# It is possible to cast RF-Objects directly
# into Grasshopper geometry types!
# Polylines, curves and free formed
# surfaces are also supported!
srf = Surface(get_data.RFSurfaces)
int = Integer(rfmember.Weight_kg)
# Get all properties of RFEM-Objects!
crv = Curve(rfmember.Line)
# The properties of the RF-Objects can be
# listed in form of plain text. Just connect
# them to a panel!
panel_5 = Panel(rfmember.StartCrossSection)
panel_6 = Panel(int)
# It is possible to define nodal supports
# with arbitrary orientations.
pln = Plane(rfnodalsupport.Location)
# Transform lists with rfem-format into
# grasshopper lists!
list_data = ListData(RFList=rfnodalsupport.NodeList)
panel_7 = Panel(list_data)
