# Grasshopper definition 02 RFCOM - Set Data.gh (Grasshopper 1.0.7)
# plug-ins: Parametric_FEM_Toolbox

# ----
# Plugin Description: This Plug-In enables an interoperability between RFEM and Grasshopper through the RFCOM API.
# 
# It allows the user to import data from RFEM into Grasshopper and also to define new model data through the Grasshopper interface.
# Contact: Diego Apellániz M.Sc.
# Ph.D. Candidate | Research Associate (UdK Berlin)
# Structural Engineer and Computational Design Specialist (Bollinger + Grohmann)
# 
# Lehrstulfür Konstruktives Entwerfen und Tragwerksplanung (KET)
# Studiengang Architektur
# Universität der Künste Berlin
# Hardenbergstr.33
# D 10623 Berlin
# 
# Telefon+49 (0)30 3185 2994
# Telefax +49 (0)30 3185 2992
# 
# E-Mail: d.apellaniz@udk-berlin.de
# Connect on Linkedin: linkedin.com/in/diegoapellaniz
# RFEM Model needs to be open
# before executing the script
# Related RFEM File(s): 02 RFCOM - Set Data.rf5
# Description: The process of exporting data from Grasshopper into RFEM revolves around the "Set Data" Component. The following concepts are explored:
# 
# - Functioning of "Set Data" Component
# - How to bake RF-Objects in RFEM
# - How to modify existing RFEM Objects.
# - How to create a Live-Link between Grasshopper and RFEM
# - Enumerations in RFEM (LineType, MemberType, SurfaceGeometryType...)
# - Versatility of Data Structures in the RFEM Plugin
grasshopper_version = Panel("1.0.0007")
plugin = Panel("Parametric FEM Toolbox")

# ---- group: 1. Geometry
number_slider = Slider(4, range=2..10)
# Define structure geometry. Curves and
# non-planar surfaces are also supported.
number_slider_2 = Slider(14.98, range=1..30)
division = Division(A=number_slider_2, B=number_slider)
series = Series(Start=0, Step=division, Count=expr("x+1", number_slider))
X = UnitX(Factor=series)
pt = ConstructPoint(XCoordinate=0, YCoordinate=0, ZCoordinate=0)
move = Move(Geometry=pt, Motion=X)  # -> Geometry, Transform
item = ListItem(List=move.Geometry, Index=0, Wrap=True)  # -> Item1, Item
panel = Panel("""-1
0""")
cull_i = CullIndex(List=move.Geometry, Indices=graft(panel), Wrap=True)
flip = FlipMatrix(Data=cull_i)
Z = UnitZ(Factor=Slider(3, range=0.5..5))
avr = Average(Input=flip)  # -> flatten(ArithmeticMean)
rev = Reverse(Vector=Z)
bang = ExplodeTree(Data=cull_i)  # -> Branch0, Branch1
# Connect a Value List to
#  Enumeration Input
# Data to see which options
#  are available!
panel_2 = Panel("{0}[1]")
move_2 = Move(Geometry=avr, Motion=rev)  # -> Geometry, Transform
relitem = RelativeItem(Tree=move_2.Geometry, Offset=panel_2, WrapPaths=False, WrapItems=False)  # -> ItemA, ItemB
ln = Line(StartPoint=bang.Branch0, EndPoint=bang.Branch1)
ln_2 = Line(StartPoint=cull_i, EndPoint=move_2.Geometry)  # -> flatten(Line)
ln_3 = Line(StartPoint=relitem.ItemA, EndPoint=relitem.ItemB)

# ---- group: 2. Bake objects in RFEM
number_slider_3 = Slider(-1, range=-1..0)
list = ValueList({"UnknownMemberType": 0, "Beam": 1, "Rigid": 2, "RibType": 3, "Truss": 4, "TrussOnlyN": 5, "Tension": 6, "Compression": 7, "Buckling": 8, "Cable": 9, "CableOnPulleys": 10, "ResultBeamType": 11, "DefinableStiffness": 12, "CouplingRigidRigid": 13, "CouplingRigidHinge": 14, "CouplingHingeHinge": 15, "CouplingHingeRigid": 16, "Spring": 17, "NullMember": 18}, selected="Truss")
# Constructor components follow the
# grasshopper logic (items, lists, trees...) in
# order to create RFEM Objects.
number_slider_4 = Slider(-1, range=-1..0)
# Click button to bake objects into an
# opened RFEM Model
pt_2 = Point(flatten([move.Geometry, move_2.Geometry]))
rfmember = RFMember(Line=ln_2, StartCrossSection=Slider(1, range=0..10), Comment="Diagonals", MemberType=list, mode="Assemble")
rfmember_2 = RFMember(Line=ln_3, StartCrossSection=Slider(3, range=0..10), Comment="Lower Chord", mode="Assemble")
# Click button to bake objects into an
# opened RFEM Model
rfnode = RFNode(PointCoordinates_m=flatten(pt_2), mode="Assemble")
rfmember_3 = RFMember(Line=ln, StartCrossSection=Slider(3, range=0..10), Comment="Upper Chord", mode="Assemble")
rfnodalsupport = RFNodalSupport(
    Location=item.Item,
    DisplacementDirX=number_slider_3,
    DisplacementDirY=number_slider_3,
    DisplacementDirZ=number_slider_3,
    RotationDirZ=number_slider_3,
    mode="Assemble")
rfnodalsupport_2 = RFNodalSupport(Location=item.Item1, DisplacementDirY=number_slider_4, DisplacementDirZ=number_slider_4, mode="Assemble")
set_data = SetData(
    RunComponent=Button(),
    RFNodes=rfnode,
    RFMembers=flatten([rfmember_3, rfmember, rfmember_2]),
    RFNodalSupports=flatten([rfnodalsupport, rfnodalsupport_2]),
    ModelName="RFCOM - Set Data")  # -> RFNodes, RFLines, RFMembers, RFSurfaces, RFOpenings, RFNodalSupports, RFLineSupports, RFSurfaceSupports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

# ----
list_2 = ValueList({"One": 1, "Two": 2, "Three": 2² - 1, "Four": Sqrt(16)}, selected="One")

# ---- group: 3. Modify RFEM Model
rfmember_4 = RFMember(RFMember=set_data.RFMembers, mode="Disassemble")  # -> Line, MemberNumber, Comment, LineNumber, MemberType, RotationAngle_, RotationType, StartCrossSection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
# Live - Link to RFEM Model
# 
# Activate toggle to modify the model
# geometry through the initial
# sliders or change the cross sections
# assigned to the member elements.
toggle = BooleanToggle(True)
panel_3 = Panel("""Upper Chord
Lower Chord
Diagonals""")
mindex = MemberIndex(Set=rfmember_4.Comment, Member=panel_3)  # -> Index, Count
rfnode_2 = RFNode(PointCoordinates_m=pt_2, RFNode=set_data.RFNodes, Modify=toggle, mode="Assemble")
number_slider_5 = Slider(4, range=1..4)
number_slider_6 = Slider(4, range=1..4)
item_2 = ListItem(List=set_data.RFMembers, Index=mindex.Index, Wrap=True)  # -> simplify(Item)
# Optionally, a model name (or a fragment of
# it) can be provided. All RFEM Models
# must be running inside of the same RFEM-
# Application.
# 
# If no name is provided, the model which
# was firstly opened will be targeted.
number_slider_7 = Slider(1, range=1..4)
toggle_2 = BooleanToggle(True)
bang_2 = ExplodeTree(Data=item_2)  # -> Branch0, Branch1, Branch2
rfmember_5 = RFMember(StartCrossSection=number_slider_7, RFMember=bang_2.Branch2, Modify=toggle_2, mode="Assemble")
toggle_3 = BooleanToggle(False)
# Objects have to be assigned an index
# number in order to be modified.
# 
# RFEM-Objects retrieved from "Set Data"
# Components have the index numbers from
# the RFEM-Model.
panel_4 = Panel("RFCOM - Set Data")
set_data_2 = SetData(RunComponent=toggle_3, RFNodes=rfnode_2, ModelName="RFCOM - Set Data")  # -> RFNodes, RFLines, RFMembers, RFSurfaces, RFOpenings, RFNodalSupports, RFLineSupports, RFSurfaceSupports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

# ----
rfmember_6 = RFMember(StartCrossSection=number_slider_6, RFMember=bang_2.Branch0, Modify=toggle_2, mode="Assemble")
rfmember_7 = RFMember(StartCrossSection=number_slider_5, RFMember=bang_2.Branch1, Modify=toggle_2, mode="Assemble")

# ---- group: 3. Modify RFEM Model (continued)
set_data_3 = SetData(RunComponent=toggle_3, RFMembers=flatten([rfmember_6, rfmember_5, rfmember_7]), ModelName=panel_4)  # -> RFNodes, RFLines, RFMembers, RFSurfaces, RFOpenings, RFNodalSupports, RFLineSupports, RFSurfaceSupports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
