# Grasshopper definition 03 Parametric FEM Toolbox - Concrete Building.gh (Grasshopper 1.0.8)
# plug-ins: Parametric_FEM_Toolbox

# ----
# Plugin Description: This Plug-In enables an interoperability between RFEM and Grasshopper through the RFCOM API.
# 
# It allows the user to import data from RFEM into Grasshopper and also to define new model data through the Grasshopper interface.
# Contact: Diego Apellániz M.Sc.
# Ph.D. Candidate | Research Associate (UdK Berlin)
# Structural Engineer and Computational Design Specialist (Bollinger + Grohmann)
# 
# Lehrstulfür Konstruktives Entwerfen und Tragwerksplanung (KET)
# Studiengang Architektur
# Universität der Künste Berlin
# Hardenbergstr.33
# D 10623 Berlin
# 
# Telefon+49 (0)30 3185 2994
# Telefax +49 (0)30 3185 2992
# 
# E-Mail: d.apellaniz@udk-berlin.de
# Connect on Linkedin: linkedin.com/in/diegoapellaniz
# Related Rhino and RFEM File(s): 03 RFCOM - Concrete Building.3dm
# 03 RFCOM - Concrete Building.rf5
# Description: The example shows the process of exporting a complete model from Grasshopper into RFEM. More information about the script can be found at:
# 
# https://courses.design-upgrade.com/courses/parametric-fem-toolbox
grasshopper_version = Panel("1.0.0007")
plugin = Panel("Parametric FEM Toolbox")

secondarybeams_crv = Curve([<curve referenced from the Rhino model> x24])
walls_srf = Surface([<surface referenced from the Rhino model> x29])
slabs_srf = Surface([<surface referenced from the Rhino model> x3])
steelcolumns_crv = Curve([<curve referenced from the Rhino model> x17])
columns_crv = Curve([<curve referenced from the Rhino model> x21])
primarybeams_crv = Curve([<curve referenced from the Rhino model> x13])
entwine = Entwine(Branch00=slabs_srf, Branch01=walls_srf, FlattenInputs=True)
rfmember = RFMember(
    Line=secondarybeams_crv,
    StartCrossSection="4",
    Comment="Secondary Beams",
    StartHinge="1",
    EndHinge="2",
    Eccentricity="1",
    Foundation="1",
    mode="Assemble")
rfmember_2 = RFMember(Line=steelcolumns_crv, StartCrossSection="2", mode="Assemble")
rfmember_3 = RFMember(Line=primarybeams_crv, StartCrossSection="3", StartHinge="1", EndHinge="2", Eccentricity="1", mode="Assemble")
rfmember_4 = RFMember(Line=columns_crv, StartCrossSection="1", mode="Assemble")
rfmaterial = RFMaterial(Description="Beton C30/37", MaterialNumber="1", mode="Assemble")
rfmaterial_2 = RFMaterial(Description="Baustahl S 235", MaterialNumber="2", mode="Assemble")
rfcrosec = RFCrossSection(Description="IPE 200", MaterialNumber="2", CrossSectionNumber="4", mode="Assemble")
rfcrosec_2 = RFCrossSection(Description="HEA 200", MaterialNumber="2", CrossSectionNumber="2", mode="Assemble")
rfcrosec_3 = RFCrossSection(Description="IPE 400", MaterialNumber="2", CrossSectionNumber="3", mode="Assemble")
rfsurface = RFSurface(
    Surface=entwine,
    MaterialNumber="1",
    Thickness_m=graft([Slider(0.3, range=0..1), Slider(0.25, range=0..1)]),
    mode="Assemble")  # -> flatten(RFSurface)
rfcrosec_4 = RFCrossSection(Description="Rechteck 350/350", MaterialNumber="1", CrossSectionNumber="1", mode="Assemble")
rfcrosec_5 = RFCrossSection(Description="RD 20", MaterialNumber="2", CrossSectionNumber="5", mode="Assemble")
cp = ControlPoints(Curve=columns_crv)  # -> flatten(Points), Weights, Knots
debrep = DeconstructBrep(Brep=walls_srf)  # -> Faces, flatten(Edges), Vertices
list = ValueList({"UnknownMemberType": 0, "Beam": 1, "Rigid": 2, "RibType": 3, "Truss": 4, "TrussOnlyN": 5, "Tension": 6, "Compression": 7, "Buckling": 8, "Cable": 9, "CableOnPulleys": 10, "ResultBeamType": 11, "DefinableStiffness": 12, "CouplingRigidRigid": 13, "CouplingRigidHinge": 14, "CouplingHingeHinge": 15, "CouplingHingeRigid": 16, "Spring": 17, "NullMember": 18}, selected="Tension")
merge = Merge(Data1=rfmaterial, Data2=rfmaterial_2)
pdecon = Deconstruct(Point=cp.Points)  # -> XComponent, YComponent, ZComponent
curvepoint = PointOnCurve(debrep.Edges, parameter=0.5)
bracing_crv = Curve([<curve referenced from the Rhino model> x18])
merge_2 = Merge(Data1=rfcrosec_4, Data2=rfcrosec_2, Data3=rfcrosec_3, Data4=rfcrosec, Data5=rfcrosec_5)
larger = LargerThan(FirstNumber=pdecon.ZComponent, SecondNumber="-0.01")  # -> LargerThan, OrEqualTo
cull = CullPattern(List=cp.Points, CullPattern=larger.LargerThan)
pdecon_2 = Deconstruct(Point=curvepoint)  # -> XComponent, YComponent, ZComponent
rfmember_5 = RFMember(Line=bracing_crv, StartCrossSection="5", MemberType=list, mode="Assemble")
merge_3 = Merge(Data1=rfmember_2, Data2=rfmember_3, Data3=rfmember, Data4=rfmember_5)
larger_2 = LargerThan(FirstNumber=pdecon_2.ZComponent, SecondNumber="-0.01")  # -> LargerThan, OrEqualTo
list_2 = ValueList({"UnknownVAlignment": 0, "Top": 1, "Middle": 2, "Bottom": 3}, selected="Top")
list_3 = ValueList({"UnknownHAlignment": 0, "Left": 1, "Center": 2, "Right": 3}, selected="Center")
cull_2 = CullPattern(List=debrep.Edges, CullPattern=larger_2.LargerThan)
rfmemberhinge = RFMemberHinge(HingeNumber="2", DisplacementDirX="-1", DisplacementDirY="-1", DisplacementDirZ="-1", mode="Assemble")
rfmemberhinge_2 = RFMemberHinge(HingeNumber="1", DisplacementDirX="-1", DisplacementDirY="-1", DisplacementDirZ="-1", RotationDirX="-1", mode="Assemble")
rfnodalsupport = RFNodalSupport(Location=cull, DisplacementDirX="-1", DisplacementDirY="-1", DisplacementDirZ="-1", mode="Assemble")
rflinesupport = RFLineSupport(Line=cull_2, DisplacementDirX="-1", DisplacementDirY="-1", DisplacementDirZ="-1", mode="Assemble")
rfmembereccentricity = RFMemberEccentricity(
    StartEccentricities="0,0,0",
    EndEccentricities="0,0,0",
    HorizontalAlignment=list_3,
    VerticalAlignment=list_2,
    mode="Assemble")
merge_4 = Merge(Data1=rfmemberhinge_2, Data2=rfmemberhinge)
list_4 = ValueList({"UnknownActionCategory": 0, "Permanent": 1, "Prestress": 2, "Imposed": 3, "TrafficLoads": 4, "SnowIce": 5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}, selected="DeadLoad": 16)
list_5 = ValueList({"UnknownActionCategory": 0, "Permanent": 1, "Prestress": 2, "Imposed": 3, "TrafficLoads": 4, "SnowIce": 5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}, selected="ImposedCategoryA": 25)
list_6 = ValueList({"UnknownActionCategory": 0, "Permanent": 1, "Prestress": 2, "Imposed": 3, "TrafficLoads": 4, "SnowIce": 5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}, selected="DeadLoad": 16)
list_7 = ValueList({"UnknownDesignSituation": 0, "NoneDesignSituation": 1, "OtherDesignSituation": 2, "ManualUls": 3, "ManualUlsAccidental": 4, "ManualSeismic": 5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}, selected="SlsCharacteristic": 47)
button = Button()
Z = UnitZ(Factor=1)
rfloadcombo = RFLoadCombination(LoadComboNumber="1", Definition="LF1 + LF2 + LF3", DesignSituation=list_7, mode="Assemble")
rfloadcase = RFLoadCase(LoadCaseNumber="1", Description="Selfweight", ActionCategory=list_4, SelfWeightFactor=Z, mode="Assemble")
rfloadcase_2 = RFLoadCase(LoadCaseNumber="3", Description="Live", ActionCategory=list_5, mode="Assemble")
rfloadcase_3 = RFLoadCase(LoadCaseNumber="2", Description="SDL", ActionCategory=list_6, mode="Assemble")
merge_5 = Merge(Data1=rfloadcase, Data2=rfloadcase_3, Data3=rfloadcase_2)
set_data = SetData(
    RunComponent=button,
    RFMembers=[rfmember_4, merge_3],
    RFSurfaces=rfsurface,
    RFNodalSupports=rfnodalsupport,
    RFLineSupports=rflinesupport,
    RFMemberHinges=merge_4,
    RFMemberEccentricities=rfmembereccentricity,
    RFCrossSections=merge_2,
    RFMaterials=merge,
    RFLoadCases=merge_5,
    RFLoadCombos=rfloadcombo,
    ModelName="Concrete")  # -> RFNodes, RFLines, RFMembers, RFSurfaces, RFOpenings, RFNodalSupports, RFLineSupports, RFSurfaceSupports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
rfmember_6 = RFMember(RFMember=set_data.RFMembers, mode="Disassemble")  # -> Line, MemberNumber, Comment, LineNumber, MemberType, RotationAngle_, RotationType, StartCrossSection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
eval = Evaluate(F="if(x = \"Secondary Beams\",1,0)", x=rfmember_6.Comment)
list_8 = ValueList({"UnknownLoadDirectionType": 0, "GlobalXType": 1, "GlobalYType": 2, "GlobalZType": 3, "LocalXType": 4, "LocalYType": 5, "LocalZType": 6, "LocalUType": 7, "LocalVType": 8, "ProjectXType": 9, "ProjectYType": 10, "ProjectZType": 11, "PerpendicularZType": 12}, selected="GlobalZType")
cull_3 = CullPattern(List=rfmember_6.MemberNumber, CullPattern=eval)
list_9 = ValueList({"UnknownLoadDirectionType": 0, "GlobalXType": 1, "GlobalYType": 2, "GlobalZType": 3, "LocalXType": 4, "LocalYType": 5, "LocalZType": 6, "LocalUType": 7, "LocalVType": 8, "ProjectXType": 9, "ProjectYType": 10, "ProjectZType": 11, "PerpendicularZType": 12}, selected="GlobalZType")
join = TextJoin(Text=cull_3, Join=",")
rfsurfaceload = RFSurfaceLoad(SurfaceList="1-3", LoadCase="2", Magnitude1_kN_m²=Slider(2.5, range=0..10), LoadDirectionType=list_8, mode="Assemble")
rfsurfaceload_2 = RFSurfaceLoad(SurfaceList="1-3", LoadCase="3", Magnitude1_kN_m²=Slider(5, range=0..10), LoadDirectionType=list_9, mode="Assemble")
rfmemberload = RFMemberLoad(Member=join, LC="2", F1=Slider(6, range=0..10), mode="Assemble")
rfmemberload_2 = RFMemberLoad(Member=join, LC="3", F1=Slider(3, range=0..10), mode="Assemble")
merge_6 = Merge(Data1=rfmemberload, Data2=rfmemberload_2)
merge_7 = Merge(Data1=rfsurfaceload, Data2=rfsurfaceload_2)
set_data_2 = SetData(RunComponent=button, RFMemberLoads=merge_6, RFSurfaceLoads=merge_7, ModelName="Concrete")  # -> RFNodes, RFLines, RFMembers, RFSurfaces, RFOpenings, RFNodalSupports, RFLineSupports, RFSurfaceSupports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
