# Grasshopper definition 03 RFCOM - Non-Planar Surfaces.gh (Grasshopper 1.0.7)
# plug-ins: Parametric_FEM_Toolbox

# ----
# Plugin Description: This Plug-In enables an interoperability between RFEM and Grasshopper through the RFCOM API.
# 
# It allows the user to import data from RFEM into Grasshopper and also to define new model data through the Grasshopper interface.
# Contact: Diego Apellániz M.Sc.
# Ph.D. Candidate | Research Associate (UdK Berlin)
# Structural Engineer and Computational Design Specialist (Bollinger + Grohmann)
# 
# Lehrstulfür Konstruktives Entwerfen und Tragwerksplanung (KET)
# Studiengang Architektur
# Universität der Künste Berlin
# Hardenbergstr.33
# D 10623 Berlin
# 
# Telefon+49 (0)30 3185 2994
# Telefax +49 (0)30 3185 2992
# 
# E-Mail: d.apellaniz@udk-berlin.de
# Connect on Linkedin: linkedin.com/in/diegoapellaniz
# Related RFEM File(s): 03 RFCOM - Non Planar Surfaces.rf5
# Description: Non-planar surfaces can be defined and imported the same way as any other surface. However, there are some particular aspects to consider when dealing with this kind of geometry. The following concepts are explored:
# 
# - Dealing with BREPS -> They have to be deconstructed into single surfaces.
# - How the Plug-In automatically sets planar surfaces as "PlaneSurfaceType" and non-planar suraces as "QuadrangleSurfaceType"
# - Dealing with toroid geometries with duplicate edges. They have to be splited into two before being imported into RFEM.
# - How to manually set the "SurfaceGeometryType" of
# RF-Objects
# - Modifying existing RF-Objects INSIDE GRASSHOPPER
grasshopper_version = Panel("1.0.0007")
plugin = Panel("Parametric FEM Toolbox")

# ----
# Non-planar surfaces can be defined and imported the same way as any other
# surface. However, there are some particular aspects to consider when dealing with this
# kind of geometry:
# BREPs have to be deconstructed into individual surfaces in
# order to be imported into RFEM
# Toroids have to be divided into two parts at
# least, so that there is no coincident
# boundary line.
toroid_brep = Brep(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)
debrep = DeconstructBrep(Brep=toroid_brep)  # -> Faces, Edges, Vertices
divide = DivideDomain²(Domain=debrep.Faces, UCount=Slider(2, range=1..20), VCount=Slider(1, range=0..1))
subsrf = Isotrim(Surface=graft(debrep.Faces), Domain=divide)  # -> flatten(Surface)
rfsurface = RFSurface(Surface=subsrf, MaterialNumber="1", Thickness_m="0.2", mode="Assemble")
set_data = SetData(RunComponent=Button(), RFSurfaces=rfsurface, ModelName="RFCOM - Non Planar Surfaces")  # -> RFNodes, RFLines, RFMembers, RFSurfaces, RFOpenings, RFNodalSupports, RFLineSupports, RFSurfaceSupports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

# ----
# The PlugIn processes automatically which
# surfaces are planar - and therefore are
# defined  as PlaneSurfaces  in RFEM -
# and which of them are nonplanar - and are
# defined as QuadrangleSurfaces.
# Another possible approach is to convert
# non-planar surfaces into a list of planar
# surfaces, so that  they have a better
# FE-Mesh, they can easily be analyzed with
# RF-Concrete and so on...
auxiliarcurve_crv = Curve(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)
divide_2 = DivideCurve(Curve=auxiliarcurve_crv, Count="100", Kinks=False)  # -> Points, Tangents, Parameters
pframe = PerpFrame(Curve=auxiliarcurve_crv, Parameter=divide_2.Parameters)
planesrf = PlaneSurface(Plane=pframe, XSize=Domain(-10, 10), YSize=Domain(-10, 10))
bbx = BrepBrep(BrepA=planesrf, BrepB=toroid_brep)  # -> Curves, Points
disc = Discontinuity(Curve=bbx.Curves, Level=1)  # -> Points, Parameters
pline = PolyLine(Vertices=disc.Points, Closed=False)
end = EndPoints(Curve=pline)  # -> Start, End
ln = Line(StartPoint=end.Start, EndPoint=end.End)
weave = Weave(Pattern=[0, 1], Stream0=ln, Stream1=pline, NullGaps=False)
join = JoinCurves(Curves=weave, Preserve=False)
crv = Curve(flatten(join))
item = ListItem(List=reverse(crv), Index=0, Wrap=True)
shift = ShiftList(List=flatten(join), Shift=1, Wrap=False)
shift_2 = ShiftList(List=flatten(join), Shift=-1, Wrap=False)
item_2 = ListItem(List=crv, Index=0, Wrap=True)
weave_2 = Weave(Pattern=[0, 1], Stream0=graft(shift_2), Stream1=graft(shift), NullGaps=False)
loft = Loft(Curves=[item, item_2], Options={Adjust=False, Closed=False, LoftEnds=0, LoftSimp=0, LoftType=3, Rebuild=10, Refit=0.01})
loft_2 = Loft(Curves=weave_2, Options={Adjust=False, Closed=False, LoftEnds=0, LoftSimp=0, LoftType=3, Rebuild=10, Refit=0.01})
join_2 = BrepJoin(Breps=flatten([loft_2, loft]))  # -> Breps, Closed
debrep_2 = DeconstructBrep(Brep=join_2.Breps)  # -> Faces, Edges, Vertices
flattenedsurfaces_srf = Surface(debrep_2.Faces)
rfsurface_2 = RFSurface(Surface=flattenedsurfaces_srf, MaterialNumber="1", Thickness_m="0.2", mode="Assemble")
set_data_2 = SetData(RunComponent=Button(), RFSurfaces=rfsurface_2, ModelName="RFCOM - Non Planar Surfaces")  # -> RFNodes, RFLines, RFMembers, RFSurfaces, RFOpenings, RFNodalSupports, RFLineSupports, RFSurfaceSupports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
rfsurface_3 = RFSurface(Surface=set_data_2.RFSurfaces, mode="Disassemble")  # -> Surface, SurfaceNumber, MaterialNumber, Thickness_m, Comment, BoundaryLinesList, GeometryType, ThicknessType, StiffnessType, Area_m²

list = ValueList({"UnknownGeometryType": 0, "PlaneSurfaceType": 1, "QuadrangleSurfaceType": 2, "BSplineSurfaceType": 3, "RotatedSurfaceType": 4, "PipeSurfaceType": 5, "TrajectorySurfaceType": 6, "NurbsSurfaceType": 7, "MinimumCurvatureSurfaceType": 8, "PartialSurfaceType": 9, "ComponentSurfaceType": 10}, selected="QuadrangleSurfaceType")

# ----
# Alternatively, is it also possible to define
# all surfaces as QuadrangleSurfaces.
# Again, take a look to the description of the
# input parameter to see which the names of
# the geometry types are.
# These surfaces are not existing elements
# in RFEM which have to be modified - we
# just want to modify an existing object in
# Grasshopper which will be imported as
# new geometry in RFEM- so in this case,
# "Modify" has to be set to "False" (or just
# leave the default value).
toggle = BooleanToggle(False)
rfsurface_4 = RFSurface(SurfaceType=list, Surface_2=rfsurface_2, Modify=toggle, mode="Assemble")
set_data_3 = SetData(RunComponent=Button(), RFSurfaces=rfsurface_4, ModelName="RFCOM - Non Planar Surfaces")  # -> RFNodes, RFLines, RFMembers, RFSurfaces, RFOpenings, RFNodalSupports, RFLineSupports, RFSurfaceSupports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
