# Grasshopper definition 04 Parametric FEM Toolbox - Scripting.gh (Grasshopper 1.0.7)
# plug-ins: Parametric_FEM_Toolbox

# ----
# Plugin Description: This Plug-In enables an interoperability between RFEM and Grasshopper through the RFCOM API.
# 
# It allows the user to import data from RFEM into Grasshopper and also to define new model data through the Grasshopper interface.
# Contact: Diego Apellániz M.Sc.
# Ph.D. Candidate | Research Associate (UdK Berlin)
# Structural Engineer and Computational Design Specialist (Bollinger + Grohmann)
# 
# Lehrstulfür Konstruktives Entwerfen und Tragwerksplanung (KET)
# Studiengang Architektur
# Universität der Künste Berlin
# Hardenbergstr.33
# D 10623 Berlin
# 
# Telefon+49 (0)30 3185 2994
# Telefax +49 (0)30 3185 2992
# 
# E-Mail: d.apellaniz@udk-berlin.de
# Connect on Linkedin: linkedin.com/in/diegoapellaniz
# Description: This Plug-In supports the use of Grasshopper Scripting Components to deal with RF-Objects.
# 
# Two C# scripts are included in this file to show how to read properties of RF-Objects and how to create new RF-Objects or modify existing ones.
related_rfem_file_s = Panel("04 RFCOM - Scripting.rf5")
grasshopper_version = Panel("1.0.0007")
plugin = Panel("Parametric FEM Toolbox")

# ---- group: Read
# Take a look into the inside of these Grasshopper Scripting Components to learn
# how to deal with the RF-Objects of this PlugIn. Just reference this Plug-In assembly
# and the Dlubal dll and start scripting!
# Grasshopper Scripting Components can be
# used to get the properties of RF-Objects
rf_object = RFObject([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])
c_script = CSharpScript(
    iRFMembers=rf_object,
    Reference=["C:\Users\diego\AppData\Roaming\Grasshopper\Libraries\Parametric_FEM_Toolbox.gha", "C:\Users\diego\OneDrive\Otros\cominterfaces\SDK\Reference Assemblies\x64\Dlubal.RFEM5.dll"])  # -> out, W1, W2; inputs iRFMembers: list
# ---------- c_script: C# usings ----------
using Parametric_FEM_Toolbox.RFEM;
# ---------- c_script: C# ----------
    //Output variables
    var totalWeightDlubal = 0.0;
    var totalWeightRFEM_daq = 0.0;


    // Loop through all input RF-Objects
    foreach (var item in iRFMembers)
    {
      // Set RFMember from the input RF-Objects
      var myMember = item as RFMember;

      // It is possible to cast RF-Objects into original Dlubal objects;
      var myDlubalMember = (Dlubal.RFEM5.Member) myMember;

      // Compute Weight of Members - either directly from the RF-Members (PlugIn) or from the Dlubal-Members
      totalWeightRFEM_daq += myMember.Weight;
      totalWeightDlubal += myDlubalMember.Weight;
    }

    // Output
    W1 = totalWeightRFEM_daq;
    W2 = totalWeightDlubal;
# ---------- end c_script ----------
crv = Curve(rf_object)
panel = Panel(c_script.W1)
panel_2 = Panel(c_script.W2)

# ---- group: Write
# Is it also possible to create or modify
# RF-Objects through Grasshopper Scripting
# Components
number_slider = Slider(3, range=0..10)
c_script_2 = CSharpScript(
    r=number_slider,
    n=Slider(8, range=0..20),
    h=Slider(4.4, range=0..10),
    Reference=["C:\Users\diego\AppData\Roaming\Grasshopper\Libraries\Parametric_FEM_Toolbox.gha", "C:\Users\diego\OneDrive\Otros\cominterfaces\SDK\Reference Assemblies\x64\Dlubal.RFEM5.dll"])  # -> out, oRFNodes; inputs r: Double, n: Int32, h: Double
# ---------- c_script_2: C# usings ----------
using Parametric_FEM_Toolbox.RFEM;
using Dlubal.RFEM5;
# ---------- c_script_2: C# ----------
    // Output List of RF-Objects
    var outRFNodes = new List<RFNode>();

    // Generate Helix of RF-MNodes
    for (int i = 0; i < n + 1; i++)
    {
      var x = r * Math.Cos(2 * Math.PI * i / n);
      var y = r * Math.Sin(2 * Math.PI * i / n);
      var z = i / (double) n * h;
      var dlubalNode = new Node();
      dlubalNode.X = x;
      dlubalNode.Y = y;
      dlubalNode.Z = z;
      outRFNodes.Add(new RFNode(dlubalNode));
    }

    // Output
    oRFNodes = outRFNodes;
# ---------- end c_script_2 ----------
rf_object_2 = RFObject(c_script_2.oRFNodes)
pt = Point(rf_object_2)
# Update reference assemblies with the
# Plugin gha file from the Grasshopper
# components folder and the dll file from
# the folder of this grasshopper definition
set_data = SetData(RunComponent=Button(), RFNodes=rf_object_2, ModelName="Scripting")  # -> RFNodes, RFLines, RFMembers, RFSurfaces, RFOpenings, RFNodalSupports, RFLineSupports, RFSurfaceSupports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
