# Grasshopper definition 04 RFCOM - Scripting.gh (Grasshopper 1.0.7)
# plug-ins: daqRFEM

# ----
# B+G Team: B+G Ingenieure Bollinger und Grohmann GmbH
# Alt-Moabit 103  / D-10559 Berlin  / Tel. +49 30 - 41 95 369 0  / Fax +49 30 - 41 95 369 99
# Diego Apellániz
# dapellaniz@bollinger-grohmann.de
# Description: This Plug-In supports the use of Grasshopper Scripting Components to deal with RF-Objects.
# 
# Two C# scripts are included in this file to show how to read properties of RF-Objects and how to create new RF-Objects or modify existing ones.
grasshopper_version = Panel("1.0.0007")
# Plugin Description: This Plug-In enables an interoperability between RFEM and Grasshopper through the RFCOM API.
# 
# It allows the user to import data from RFEM into Grasshopper and also to define new model data through the Grasshopper interface.
plugin = Panel("RFEM")
related_rfem_file_s = Panel("04 RFCOM - Scripting.rf5")

# ---- group: Write
# Is it also possible to create or modify
# RF-Objects through Grasshopper Scripting
# Components
number_slider = Slider(3, range=0..10)
c_script = CSharpScript(
    r=number_slider,
    n=Slider(8, range=0..20),
    h=Slider(4.4, range=0..10),
    Reference=["D:\Diego\AppData\Roaming\Grasshopper\Libraries\RFEM_daq.gha", "D:\Diego\Documentos\Otros\SDK_en\Reference Assemblies\x64\Dlubal.RFEM5.dll"])  # -> out, oRFNodes; inputs r: Double, n: Int32, h: Double
# ---------- c_script: C# usings ----------
using RFEM_daq.RFEM;
using Dlubal.RFEM5;
# ---------- c_script: C# ----------
    // Output List of RF-Objects
    var outRFNodes = new List<RFNode>();

    // Generate Helix of RF-MNodes
    for (int i = 0; i < n + 1; i++)
    {
      var x = r * Math.Cos(2 * Math.PI * i / n);
      var y = r * Math.Sin(2 * Math.PI * i / n);
      var z = i / (double) n * h;
      var dlubalNode = new Node();
      dlubalNode.X = x;
      dlubalNode.Y = y;
      dlubalNode.Z = z;
      outRFNodes.Add(new RFNode(dlubalNode));
    }

    // Output
    oRFNodes = outRFNodes;
# ---------- end c_script ----------
rf_object = RFObject(c_script.oRFNodes)
pt = Point(rf_object)
set_data = SetData(RunComponent=Button(), RFNodes=rf_object, ModelName="RFCOM - Scripting")  # -> RFNodes, RFLines, RFMembers, RFSurfaces, RFOpenings, RFNodalSupports, RFLineSupports, RFLineHinges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

# ---- group: Read
# Take a look into the inside of these Grasshopper Scripting Components to learn
# how to deal with the RF-Objects of this PlugIn. Just reference this Plug-In assembly
# and the Dlubal dll and start scripting!
# Grasshopper Scripting Components can be
# used to get the properties of RF-Objects
rf_object_2 = RFObject([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])
c_script_2 = CSharpScript(
    iRFMembers=rf_object_2,
    Reference=["D:\Diego\Documentos\Otros\SDK_en\Reference Assemblies\x64\Dlubal.RFEM5.dll", "D:\Diego\AppData\Roaming\Grasshopper\Libraries\RFEM_daq.gha"])  # -> out, W1, W2; inputs iRFMembers: list
# ---------- c_script_2: C# usings ----------
using RFEM_daq.RFEM;
# ---------- c_script_2: C# ----------
    //Output variables
    var totalWeightDlubal = 0.0;
    var totalWeightRFEM_daq = 0.0;


    // Loop through all input RF-Objects
    foreach (var item in iRFMembers)
    {
      // Set RFMember from the input RF-Objects
      var myMember = item as RFMember;

      // It is possible to cast RF-Objects into original Dlubal objects;
      var myDlubalMember = (Dlubal.RFEM5.Member) myMember;

      // Compute Weight of Members - either directly from the RF-Members (PlugIn) or from the Dlubal-Members
      totalWeightRFEM_daq += myMember.Weight;
      totalWeightDlubal += myDlubalMember.Weight;
    }

    // Output
    W1 = totalWeightRFEM_daq;
    W2 = totalWeightDlubal;
# ---------- end c_script_2 ----------
crv = Curve(rf_object_2)
panel = Panel(c_script_2.W1)
panel_2 = Panel(c_script_2.W2)
