# Grasshopper definition 06 Parametric FEM Toolbox - Extrude Members.gh (Grasshopper 1.0.8)
# plug-ins: Parametric_FEM_Toolbox

# ----
# Plugin Description: This Plug-In enables an interoperability between RFEM and Grasshopper through the RFCOM API.
# 
# It allows the user to import data from RFEM into Grasshopper and also to define new model data through the Grasshopper interface.
# Contact: Diego Apellániz M.Sc.
# Ph.D. Candidate | Research Associate (UdK Berlin)
# Structural Engineer and Computational Design Specialist (Bollinger + Grohmann)
# 
# Lehrstulfür Konstruktives Entwerfen und Tragwerksplanung (KET)
# Studiengang Architektur
# Universität der Künste Berlin
# Hardenbergstr.33
# D 10623 Berlin
# 
# Telefon+49 (0)30 3185 2994
# Telefax +49 (0)30 3185 2992
# 
# E-Mail: d.apellaniz@udk-berlin.de
# Connect on Linkedin: linkedin.com/in/diegoapellaniz
# Related RFEM File(s): 06 RFCOM - Extrude Members.rf5
# Description: It is indeed possible to import cross section shapes into Grasshopper in order to extrude members into 3D objects.
# 
# Some key aspects to take into account:
# 
# - Have a look into the member types of your structure first. Some member types such as "Rigid", "Tension", etc. don´t provide information of assigned cross sections.
# 
# - Imported cross sections are automatically rebuilt in Grasshopper. This process might cause errors.
# 
# - Both NURBS and Meshes supported
# for output geometry.
grasshopper_version = Panel("1.0.0007")
plugin = Panel("Parametric FEM Toolbox")

# ----
# Only Beam members will be imported.
# Some member types such as Rigid,
# Tension, etc. don´t provide information of
# assigned cross sections.
panel = Panel("Extrude Members")
toggle = BooleanToggle(True)
get_data = GetData(RunComponent=Button(), Members=toggle, CrossSections=toggle, ModelName=panel)  # -> RFNodes, RFLines, RFMembers, RFSurfaces, RFOpenings, RFNodalSupports, RFLineSupports, RFSurfaceSupports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
# Provide RF Member and RF Cross Sections
# and extrude beam elements as 3d shapes
# in Grasshopper!
# Adjust resolution for curved members and
# output meshes
# Both NURBS and Meshes supported
# for output geometry
# Visualization of eccentricities now supported!!
extrude = ExtrudeMembers(RFMembers=get_data.RFMembers, RFCroSec=get_data.RFCrossSections, mode="NURBS", menu=[slider(1)])
