# Grasshopper definition 07 Parametric FEM Toolbox - Calculation.gh (Grasshopper 1.0.7)
# plug-ins: Parametric_FEM_Toolbox

# ----
# Plugin Description: This Plug-In enables an interoperability between RFEM and Grasshopper through the RFCOM API.
# 
# It allows the user to import data from RFEM into Grasshopper and also to define new model data through the Grasshopper interface.
# Contact: Diego Apellániz M.Sc.
# Ph.D. Candidate | Research Associate (UdK Berlin)
# Structural Engineer and Computational Design Specialist (Bollinger + Grohmann)
# 
# Lehrstulfür Konstruktives Entwerfen und Tragwerksplanung (KET)
# Studiengang Architektur
# Universität der Künste Berlin
# Hardenbergstr.33
# D 10623 Berlin
# 
# Telefon+49 (0)30 3185 2994
# Telefax +49 (0)30 3185 2992
# 
# E-Mail: d.apellaniz@udk-berlin.de
# Connect on Linkedin: linkedin.com/in/diegoapellaniz
# Description: The "Get Results" component retrieves
# the results of the CALCULATED load
# cases and load combinations from RFEM.
# The output of the component is the
# deformed model shape and the
# calculation results of the selected load
# case and combo.
related_rfem_file_s = Panel("07 RFCOM - Calculation.rf5")
grasshopper_version = Panel("1.0.0007")
# The "Get Results" component retrieves
# the results of the CALCULATED load
# cases and load combinations from RFEM.
# The output of the component is the
# deformed model shape and the
# calculation results of the selected load
# case and combo.
plugin = Panel("Parametric FEM Toolbox")

# ----
# Use a button
# instead of a toggle
# Scale of deformed shape
# Select load case or load combination from
# the drop down menus. Only the calculated
# cases are included.
# 
# In case of errors from the API regarding
# load combinations, make sure, that the
# load cases that make up that load
# combination are already calculated.
number_slider = Slider(500, range=0..1000)
# Select calculation results to include in the
# component output. The component
# includes several functionalities to minimize
# the execution time when importing results
# from RFEM.
panel = Panel("Calculation")
get_results = GetResults(
    RunComponent=Button(),
    ScaleFactor=number_slider,
    ModelName=panel,
    menu=[dropdown(0), dropdown(0), buttons(on, off), checkbox(on), checkbox(on), checkbox(on), checkbox(on), checkbox(on)])  # -> CalculationResults, Curves, MemberNo, Meshes, SurfaceNo
# Calculation Results
sforces = SurfaceForces(CalculationResults=get_results.CalculationResults)  # -> SurfaceNumber, Coordinates, Location, AxialForceAlphaM, AxialForceN1, AxialForceN2, AxialForceNcD, AxialForceNx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
nsforces = NodalSupportForces(CalculationResults=get_results.CalculationResults)  # -> SupportNumber, Location, Forces, Moments
# Force Vector: (Nx, Vy, Vz)
# Moment Vector: (Mx, My, Mz)
mforces = MemberForces(CalculationResults=get_results.CalculationResults)  # -> MemberNumber, Location, Forces, Moments, ResultsFlag
bnd = Bounds(Numbers=flatten(sforces.MomentM1))
number_slider_2 = Slider(0.2, range=0..1)
dedomain = DeconstructDomain(Domain=bnd)  # -> Start, End
multiplication = Multiplication(A=dedomain.End, B=number_slider_2)
multiplication_2 = Multiplication(A=dedomain.Start, B=number_slider_2)
dom = ConstructDomain(DomainStart=multiplication_2, DomainEnd=multiplication)
remap = RemapNumbers(Value=sforces.MomentM1, Source=dom, Target=Domain(0, 1))  # -> Mapped, Clipped
gradient = Gradient(
    LowerLimit=0,
    UpperLimit=1,
    Parameter=remap.Mapped,
    stops=[0: RGB(234, 38, 0), 0.25: RGB(234, 126, 0), 0.75: RGB(173, 203, 249), 1: RGB(75, 107, 169)])
# The deformed shape can be use for
# graphical representation of results.
# Turn on component visibility to show
# mesh colors!
mcol = MeshColours(Mesh=graft(get_results.Meshes), Colours=gradient)
# Use the overwrite panel to manually
# specify the load case or load combination
# to get results from
button = Button()

# ---- group: Connect!
# Keywords:
# "LoadCase",
# "LoadCombo",
# "ResultCombo".
panel_2 = Panel("LoadCase 1")
panel_3 = Panel("LoadCase 2")
# The value lsit will be updated once
# connected to the input parameter. Select
# standard value type.
list = ValueList({"One": 1, "Two": 2, "Three": 2² - 1, "Four": Sqrt(16)}, selected="One")

# ----
# This is the only way to get results from
# several load cases or load combinations
# through the same grasshopper
# component!
get_results_2 = GetResults(
    RunComponent=button,
    menu=[dropdown(0), dropdown(0), buttons(on, off), checkbox(on), checkbox(on), checkbox(on), checkbox(on), checkbox(on)])  # -> CalculationResults, Curves, MemberNo, Meshes, SurfaceNo
button_2 = Button()
get_data = GetData(RunComponent=button_2, LoadCases=Toggle(True), ModelName="Calculation")  # -> RFNodes, RFLines, RFMembers, RFSurfaces, RFOpenings, RFNodalSupports, RFLineSupports, RFSurfaceSupports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
list_2 = ValueList({"UnknownValueType": 0, "StandardValueType": 1, "MaximumValueType": 2, "MinimumValueType": 3, "MaximumAlongX": 4, "MinimumAlongX": 5, "MaximumAlongY": 6, "MinimumAlongY": 7, "MaximumAlongZ": 8, "MinimumAlongZ": 9, "MaximumAroundX": 10, "MinimumAroundX": 11, "MaximumAroundY": 12, "MinimumAroundY": 13, "MaximumAroundZ": 14, "MinimumAroundZ": 15}, selected="StandardValueType")
int = Integer(get_data.RFLoadCases)
int_2 = Integer(get_data.RFLoadCombos)
concat = Concatenate(FragmentA="LoadCase", FragmentB=int, JoinSeparator=" ")
concat_2 = Concatenate(FragmentA="LoadCombo", FragmentB=int_2, JoinSeparator=" ")
# Calculation results from all load cases
# defined in the RFEM Model
get_results_3 = GetResults(
    RunComponent=button_2,
    OverwriteLoadCaseOrCombo=concat,
    OverwriteResultType=list_2,
    ModelName="Calculation",
    menu=[dropdown(0), dropdown(0), buttons(on, off), checkbox(on), checkbox(on), checkbox(on), checkbox(on), checkbox(on)])  # -> CalculationResults, Curves, MemberNo, Meshes, SurfaceNo
