# Grasshopper definition 07 RFCOM - Calculation.gh (Grasshopper 1.0.7)
# plug-ins: Parametric_FEM_Toolbox

# ----
# Plugin Description: This Plug-In enables an interoperability between RFEM and Grasshopper through the RFCOM API.
# 
# It allows the user to import data from RFEM into Grasshopper and also to define new model data through the Grasshopper interface.
# Contact: Diego Apellániz M.Sc.
# Ph.D. Candidate | Research Associate (UdK Berlin)
# Structural Engineer and Computational Design Specialist (Bollinger + Grohmann)
# 
# Lehrstulfür Konstruktives Entwerfen und Tragwerksplanung (KET)
# Studiengang Architektur
# Universität der Künste Berlin
# Hardenbergstr.33
# D 10623 Berlin
# 
# Telefon+49 (0)30 3185 2994
# Telefax +49 (0)30 3185 2992
# 
# E-Mail: d.apellaniz@udk-berlin.de
# Connect on Linkedin: linkedin.com/in/diegoapellaniz
# Description: Through this example, you will learn to:
# 
# - Edit existing RFEM Models
# - Run the analysis of structural models from Grasshopper
# - Run a cross section optimization from grasshopper
# - Combine the cross section optimization with a geometric optimization using Galapagos
related_rfem_file_s = Panel("07 RFCOM - Calculation.rf5")
grasshopper_version = Panel("1.0.0007")
plugin = Panel("Parametric FEM Toolbox")

dom = ConstructDomain(DomainStart="-0.5", DomainEnd="-10")
filter_data = FilterData(Z_m=dom, mode="Nodes")
get_data = GetData(RunComponent=Button(), Nodes=Toggle(True), Filter=filter_data)  # -> RFNodes, RFLines, RFMembers, RFSurfaces, RFOpenings, RFNodalSupports, RFLineSupports, RFSurfaceSupports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
number_slider = Slider(-5, range=-6..-0.5)
pdecon = Deconstruct(Point=get_data.RFNodes)  # -> XComponent, YComponent, ZComponent
pt = ConstructPoint(XCoordinate=pdecon.XComponent, YCoordinate=pdecon.YComponent, ZCoordinate=number_slider)
# Modify an existing RFEM Model
toggle = BooleanToggle(True)
rfnode = RFNode(PointCoordinates_m=pt, RFNode=get_data.RFNodes, Modify=toggle, mode="Assemble")
set_data = SetData(RunComponent=Toggle(False), RFNodes=rfnode)  # -> RFNodes, RFLines, RFMembers, RFSurfaces, RFOpenings, RFNodalSupports, RFLineSupports, RFSurfaceSupports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
# Structural optimization through
# EC3 Module from RFEM
toggle_2 = BooleanToggle(False)
# Geometric optimization with Galapagos:
#  - Fitness -> Steel mass
#  - Genome -> Truss height
panel = Panel("1")
optimize_crosec = OptimizeCrossSections(LoadCombinations=panel, RunComponent=toggle_2, Trigger=set_data.RFNodes)
galapagos = Galapagos(fitness=num, gene=number_slider)
num = Number(optimize_crosec)
panel_2 = Panel(num)

# ----
# Geometric + Cross Section Optimization
number_slider_2 = Slider(100, range=0..100)
# Deformed shape
button = Button()
get_results = GetResults(RunComponent=button, ScaleFactor=number_slider_2, menu=[dropdown(0)])  # -> Curves, Meshes
