# Grasshopper definition 09 Parametric FEM Toolbox - NurbsSurfaces.gh (Grasshopper 1.0.7)
# plug-ins: Parametric_FEM_Toolbox

# ----
# Plugin Description: This Plug-In enables an interoperability between RFEM and Grasshopper through the RFCOM API.
# 
# It allows the user to import data from RFEM into Grasshopper and also to define new model data through the Grasshopper interface.
# Contact: Diego Apellániz M.Sc.
# Ph.D. Candidate | Research Associate (UdK Berlin)
# Structural Engineer and Computational Design Specialist (Bollinger + Grohmann)
# 
# Lehrstulfür Konstruktives Entwerfen und Tragwerksplanung (KET)
# Studiengang Architektur
# Universität der Künste Berlin
# Hardenbergstr.33
# D 10623 Berlin
# 
# Telefon+49 (0)30 3185 2994
# Telefax +49 (0)30 3185 2992
# 
# E-Mail: d.apellaniz@udk-berlin.de
# Connect on Linkedin: linkedin.com/in/diegoapellaniz
# Description: Through this example, you will learn to:
# 
# - Model Nurbs Surfaces in Grasshopper so they can be imported into RFEM
# - Import Nurbs Surfaces into RFEM
# - Import Nurbs Surfaces from RFEM into Grasshopper
related_rfem_file_s = Panel("09 RFCOM - NurbsSurfaces.rf5")
grasshopper_version = Panel("1.0.0007")
plugin = Panel("Parametric FEM Toolbox")

# ----
# The number of nodes in the Nurbs Surface must
#  be between 3 and 17. If the UV parameter is
# greater than 16, an import error occurs.
# Therefore the Grasshopper geometry was
# divided into several surfaces to achieve a higher
# resolution in RFEM
number_slider = Slider(16, range=0..100)
range = Range(Domain=Domain(0, 1), Steps=Slider(4, range=0..10))
consec = ConsecutiveDomains(Numbers=range, Additive=Toggle(False))
addition = Addition(A=number_slider, B="1")
crossref = CrossReference(ListA=consec, ListB=consec, CrossMode=1)  # -> ListA, ListB
sqr = Square(Value=addition)
rectangle = Rectangle(Plane=PlaneXY(0, 0, 0), XSize=crossref.ListA, YSize=crossref.ListB, Radius=0)  # -> Rectangle, Length
number_slider_2 = Slider(0.25, range=0..1)
sdivide = DivideSurface(Surface=reparameterize(rectangle.Rectangle), UCount=number_slider, VCount=number_slider)  # -> Points, Normals, flatten(Parameters)
partition = PartitionList(List=sdivide.Parameters, Size=sqr)
pdecon = Deconstruct(Point=partition)  # -> XComponent, YComponent, ZComponent
remap = RemapNumbers(Value=pdecon.XComponent, Source=Domain(0, 1), Target=graft(crossref.ListA))  # -> Mapped, Clipped
remap_2 = RemapNumbers(Value=pdecon.YComponent, Source=Domain(0, 1), Target=graft(crossref.ListB))  # -> Mapped, Clipped
pt = ConstructPoint(XCoordinate=remap.Mapped, YCoordinate=remap_2.Mapped, ZCoordinate=0)
image = ImageSampler(
    pt,
    FilePath="C:\Users\diego\OneDrive\Projects\Repos\Parametric_FEM_Toolbox\Examples\09 - NurbsSurfaces\terrain.png",
    Filter="Value",
    Interpolate=False,
    Umax=1,
    Umin=0,
    Vmax=1,
    Vmin=0,
    Wrap=1)
remap_3 = RemapNumbers(Value=image, Source=Domain(0, 1), Target=Slider(1.51, range=0..10))  # -> Mapped, Clipped
Z = UnitZ(Factor=remap_3.Mapped)
move = Move(Geometry=pt, Motion=Z)  # -> Geometry, Transform
number_slider_3 = Slider(10, range=0..10)
list = ValueList({"UnknownGeometryType": 0, "PlaneSurfaceType": 1, "QuadrangleSurfaceType": 2, "BSplineSurfaceType": 3, "RotatedSurfaceType": 4, "PipeSurfaceType": 5, "TrajectorySurfaceType": 6, "NurbsSurfaceType": 7, "MinimumCurvatureSurfaceType": 8, "PartialSurfaceType": 9, "ComponentSurfaceType": 10}, selected="NurbsSurfaceType")
# 2
button = Button()
scale_nu = ScaleNU(Geometry=move.Geometry, Plane=PlaneXY(0, 0, 0), ScaleX=number_slider_3, ScaleY=number_slider_3, ScaleZ=1)  # -> Geometry, Transform
srfgrid = SurfaceFromPoints(Points=scale_nu.Geometry, UCount=expr("x+1", number_slider), Interpolate=False)  # -> flatten(Surface)
get_data = GetData(RunComponent=button, Surfaces=Toggle(True), ModelName="Nurbs")  # -> RFNodes, RFLines, RFMembers, RFSurfaces, RFOpenings, RFNodalSupports, RFLineSupports, RFSurfaceSupports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
rfsurface = RFSurface(Surface=srfgrid, MaterialNumber="2", Thickness_m="0.01", SurfaceType=list, mode="Assemble")
# 1
button_2 = Button()
# It's also possible to import Nurbs Surfaces from
# RFEM to Grasshopper.
srf = Surface(get_data.RFSurfaces)
set_data = SetData(RunComponent=button_2, RFSurfaces=rfsurface, ModelName="Nurbs")  # -> RFNodes, RFLines, RFMembers, RFSurfaces, RFOpenings, RFNodalSupports, RFLineSupports, RFSurfaceSupports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
