# Grasshopper definition 10 Parametric FEM Toolbox - LCA.gh (Grasshopper 1.0.7)
# plug-ins: One Click LCA, Parametric_FEM_Toolbox

# ----
# Plugin Description: This Plug-In enables an interoperability between RFEM and Grasshopper through the RFCOM API.
# 
# It allows the user to import data from RFEM into Grasshopper and also to define new model data through the Grasshopper interface.
# Contact: Diego Apellániz M.Sc.
# Ph.D. Candidate | Research Associate (UdK Berlin)
# Structural Engineer and Computational Design Specialist (Bollinger + Grohmann)
# 
# Lehrstulfür Konstruktives Entwerfen und Tragwerksplanung (KET)
# Studiengang Architektur
# Universität der Künste Berlin
# Hardenbergstr.33
# D 10623 Berlin
# 
# Telefon+49 (0)30 3185 2994
# Telefax +49 (0)30 3185 2992
# 
# E-Mail: d.apellaniz@udk-berlin.de
# Connect on Linkedin: linkedin.com/in/diegoapellaniz
# Additional Plugins: One Click LCA
# https://oneclicklca.zendesk.com/hc/en-us/articles/360019399220-Grasshopper-Integration
# Description: Through this example, you will learn to:
# 
# - Prepare the bill of quantities from the RFEM model to serve as input for a LCA
# - Run a LCA with the plugin of One Click LCA with the input from an RFEM model
related_rfem_file_s = Panel("10 RFCOM - LCA.rf5")
grasshopper_version = Panel("1.0.0007")
plugin = Panel("Parametric FEM Toolbox")

lca = InputForLCA(RunComponent=Button(), ModelName="LCA")  # -> Materials, Geometry, Mass, Volume
panel = Panel(lca.Materials)
bang = ExplodeTree(Data=lca.Volume)  # -> Branch0, Branch1, Branch2, Branch3
bang_2 = ExplodeTree(Data=lca.Geometry)  # -> Branch0, Branch1, Branch2, Branch3
multiplication = Multiplication(A="250", B=bang.Branch0)
lca_2 = LCAObject(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)
lca_3 = LCAObject(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)
lca_4 = LCAObject(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)
lca_5 = LCAObject(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)
lca_6 = LCAObject(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)
material = DefineMaterial(LCAProfile=lca_2, Geometry=bang_2.Branch1, SetQuantity=bang.Branch1, mode="SI", menu=[dropdown(None)])
material_2 = DefineMaterial(LCAProfile=lca_3, Geometry=bang_2.Branch3, SetQuantity=bang.Branch3, mode="SI", menu=[dropdown(None)])
material_3 = DefineMaterial(LCAProfile=lca_4, Geometry=bang_2.Branch2, SetQuantity=bang.Branch2, mode="SI", menu=[dropdown(None)])
material_4 = DefineMaterial(LCAProfile=lca_5, Geometry=bang_2.Branch0, SetQuantity=bang.Branch0, mode="SI", menu=[dropdown(None)])
material_5 = DefineMaterial(LCAProfile=lca_6, SetQuantity=multiplication, mode="SI", menu=[dropdown(None)])
entwine = Entwine(Branch00=material_4, Branch01=material_5, FlattenInputs=True)
construction = CreateConstruction(Material=material, menu=[dropdown(None)])
construction_2 = CreateConstruction(Material=material_2, menu=[dropdown(None)])
construction_3 = CreateConstruction(Material=material_3, SetClass="BEAMS", menu=[dropdown(None)])
flip = FlipMatrix(Data=entwine)
construction_4 = CreateConstruction(Material=flip, GroupMaterials=Toggle(True), menu=[dropdown(None)])
lca_7 = RunLCA(
    Construction=[construction, construction_2, construction_3, construction_4],
    RunLCA=Toggle(True),
    Login=Button(),
    RunInCloud=Toggle(False))  # -> Construction, KgCO2e
co2e_kg = Number(lca_7.KgCO2e)
kg_co2e = Panel(co2e_kg)
results = VisualizeResults(
    Construction=lca_7.Construction,
    menu=[slider(0.3), buttons(off, off, off, off, off, off, off, off, off, off, off), dropdown(None), dropdown(None), slider(0), slider(100), buttons(on, off, off, off, off, off)])
